# Grasshopper definition 00_ElementExtraction.gh (Grasshopper 1.0.7)
# plug-ins: Volvox, Rhino.Inside for Autodesk Revit, EleFront, Scan2BIM

# ----
# 0.Select REVIT GEOMETRIES
element = Element(simplify(graft([<wall referenced from the Revit model> x4, <familyinstance referenced from the Revit model>, <floor referenced from the Revit model> x2, <familyinstance referenced from the Revit model>, <floor referenced from the Revit model>, <familyinstance referenced from the Revit model> x3, <floor referenced from the Revit model> x2, <wall referenced from the Revit model> x3, <familyinstance referenced from the Revit model> x6])))
element_geometry = ElementGeometry(Elements=element)  # -> simplify(Geometry)
brep = Brep(element_geometry)
null_item = NullItem(Item=brep)  # -> NullFlags, InvalidFlags, Description
cull_pattern = CullPattern(List=brep, CullPattern=invert(null_item.NullFlags))
cull_pattern_2 = CullPattern(List=element, CullPattern=invert(null_item.NullFlags))
clean_tree = CleanTree(RemoveNulls=True, RemoveInvalid=True, RemoveEmpty=True, Tree=cull_pattern_2)
clean_tree_2 = CleanTree(RemoveNulls=True, RemoveInvalid=True, RemoveEmpty=True, Tree=cull_pattern)

# ----
# 1.Load  and segment point cloud
abort = Button()
run = Button()
file_path = FilePath("D:\Data\2018-06 Werfopvolging Academiestraat Gent\week 22\PCD\week22 photogrammetry - Cloud.e57")
loade57 = LoadE57(FilePath=file_path, Index=-1, Percent=1, Run=run, Abort=abort, Check=True)  # -> Cloud, Pose
key = Key("d")
mesh_compare = MeshCompare(Cloud=loade57.Cloud, Mesh=clean_tree_2, Key=key)
construct_domain = ConstructDomain(DomainStart=0, DomainEnd=Slider(0.5, range=0..1))
cull_cloud = CullCloud(Cloud=mesh_compare, Key=key, Domain=construct_domain)  # -> simplify(Cloud)
merge_clouds = MergeClouds(Cloud=cull_cloud)
cloud_statistics = CloudStatistics(Cloud=merge_clouds)  # -> Count, Colors, Colors_2
larger_than = LargerThan(FirstNumber=cloud_statistics.Count, SecondNumber=Slider(2, range=0..10))  # -> LargerThan, OrEqualTo
dispatch = Dispatch(List=clean_tree, DispatchPattern=larger_than.LargerThan)  # -> ListA, ListB
dispatch_2 = Dispatch(List=merge_clouds, DispatchPattern=larger_than.LargerThan)  # -> ListA, ListB

mesh_brep = MeshBrep(
    Brep=clean_tree_2,
    Settings={GridMaxCount=0, GridMinCount=16, JaggedSeams=False, MaxEdgeLength=0, MinEdgeLength=0.0001, MinTolerance=0, Refine=True, RefineAngle=0, RelativeTolerance=0.65, SimplePlanes=True, Tolerance=0})

# ----
# Save point clouds as one file
element_passport = ElementPassport(Element=dispatch.ListA)  # -> flatten(DocumentGUID), Document, UniqueID, Id
file_path_2 = FilePath("D:\Data\2018-06 Werfopvolging Academiestraat Gent\week 22\MONITORING DATA\PCD.e57")
abort_2 = Button()
run_2 = Button()
list_item = ListItem(List=element_passport.DocumentGUID, Index=0, Wrap=True)
save_e57_ex = SaveE57Ex(Scans=graft(dispatch_2.ListA), AtomS=False, AtomE=False, Spherical=False, Run=run_2, Abort=abort_2)

# ----
# WRITE GEOMETRY
element_name = ElementName(Element=clean_tree)  # -> Element, Name
element_category = ElementCategory(Element=element_name.Element)  # -> Element, Category
element_materials = ElementMaterials(Element=element_name.Element)  # -> Materials, Paint
text = Text(element_category.Category)
number = Number(1)

element_passport_2 = ElementPassport(Element=element_name.Element)  # -> DocumentGUID, Document, UniqueID, Id
panel = Panel(element_name.Element)

define_object_attributes = DefineObjectAttributes(Name=element_passport_2.Id, Layer=text, Material=element_materials.Materials)  # -> simplify(Attributes)
bake_objects = BakeObjects(Geometry=clean_tree_2, Attributes=define_object_attributes, BakeName=number, Bake=False)

# ----
# WRITE MESH GEOMETRY as one file
element_name_2 = ElementName(Element=dispatch.ListA)  # -> Element, Name
element_category_2 = ElementCategory(Element=element_name_2.Element)  # -> Element, Category
text_2 = Text(text)
define_object_attributes_2 = DefineObjectAttributes(Layer=text_2)  # -> simplify(Attributes)
number_2 = Number(2)
bake_objects_2 = BakeObjects(Geometry=dispatch_2.ListA, Attributes=define_object_attributes_2, BakeName=number_2, Bake=False)

# ----
# WRITE MESH GEOMETRY as a list of files (Open3D)
text_3 = Text(element_passport_2.Id)
replace_text = ReplaceText(Text=text_3, Find=":", Replace="_", RecursiveReplace=False)
text_4 = Text(".obj")
file_path_3 = FilePath("D:\Data\2018-06 Werfopvolging Academiestraat Gent\week 22\MONITORING DATA\")
concatenate = Concatenate(B=file_path_3, Fragment_B=replace_text, A=text_4)
export_meshes = ExportMeshes(
    FilePath=concatenate,
    Meshes=mesh_brep,
    Settings=[" _Geometry=_Mesh ", " _EndOfLine=CRLF ", " _ExportRhinoObjectNames=_DoNotExportObjectNames ", " _ExportRhinoGroupOrLayerNames=_DoNotExportGroupNames ", " _ExportMeshTextureCoordinates=_Yes ", " _ExportMeshVertexNormals=_No ", " _CreateNGons=_No ", " _ExportMaterialDefinitions=_No ", " _YUp=_No ", " _WrapLongLines=Yes ", " _VertexWelding=_Welded ", " _WritePrecision=4 ", " _Enter ", " _DetailedOptions ", " _JaggedSeams=_No ", " _PackTextures=_No ", " _Refine=_Yes ", " _SimplePlane=_No ", " _AdvancedOptions ", " _Angle=50 ", " _AspectRatio=0 ", " _Distance=0.0", " _Density=0 ", " _Density=0.45 ", " _Grid=0 ", " _MaxEdgeLength=0 ", " _MinEdgeLength=0.0001 "],
    Run=Toggle(False))

# ----
# EVALUATION
number_slider = Slider(59, range=0..1000)
number_slider_2 = Slider(0, range=0..10)
tree_statistics = TreeStatistics(Tree=concatenate)  # -> Paths, Length, Count
list_item_2 = ListItem(List=tree_statistics.Paths, Index=number_slider, Wrap=True)
tree_branch = TreeBranch(Tree=concatenate, Path=list_item_2, MaintainPaths=True)
list_item_3 = ListItem(List=tree_branch, Index=Slider(0, range=0..10), Wrap=True)

# ----
# WRITE POINT CLOUDS as a list of ply files (Open3D)
replace_text_2 = ReplaceText(Text=element_passport_2.Id, Find=":", Replace="_", RecursiveReplace=False)
text_5 = Text(".ply")
concatenate_2 = Concatenate(B=file_path_3, Fragment_B=replace_text_2, A=text_5)
export_point_cloud = ExportPointCloud(
    FilePath=concatenate_2,
    PointCloud=dispatch_2.ListA,
    Settings=[" _ExportType=_Binary", " _VertexesAsDoubles=_Yes ", " _ExportNormals=_Yes ", " _ExportColors=_Yes ", " _ExportMaterial=_No "],
    Run=Toggle(False))

panel_2 = Panel(concatenate_2)
export_e57_point_cloud = ExportE57PointCloud(FilePath=concatenate_2, Run=False)
panel_3 = Panel(concatenate)
